# Dynamo custom node Element Name Universal.dyf (Dynamo 2.3.0.5885)
# category: Bakery.Revit.Elements
# Modified for 0.8.1

Elementz = Input(Elementz: var[]..[])
list_create = List.Create(item0=Elementz)
flatten = List.Flatten(list=list_create)
python_script = Python(IN[0]=flatten)
# ---------- python_script.python (19 lines) ----------
import clr
clr.AddReference('RevitAPI')
from Autodesk.Revit.DB import *

faminsts = IN[0]
elementlist = list()
for item in faminsts:
	try:
		n = UnwrapElement(item).Name
	except:
		n = None
	# Use a built-in property of (wrapped) Dynamo elements for family symbols instead
	if n == None:
		try:
			n = item.Name
		except:
			n = []
	elementlist.append(n)
OUT = elementlist
# ----------------------------------------
Namez = Output(python_script)
