# Dynamo custom node Revit Model Cleaner.dyf (Dynamo 1.3.0.875)
# category: Bakery.Revit.Document.Utility

Revit_Links = Input()  # "Revit Links?"
get_all_revit_links_as_element = Custom[Get All Revit Links as Element List]()
switch = Custom[Switch](boolean_switch=Revit_Links, data=get_all_revit_links_as_element)
Groups = Input()  # "Groups?"
list_groups = Custom[List Groups]()
switch_2 = Custom[Switch](boolean_switch=Groups, data=list_groups.groupElements)
Views = Input()  # "Views?"
list_all_views = Custom[List All Views]()  # not including sheets
switch_3 = Custom[Switch](boolean_switch=Views, data=list_all_views)
Sheets = Input()  # "Sheets?"
categories = Categories("Sheets")
all_elements_of_category = ElementsOfCategory(categories)
watch = Watch(all_elements_of_category)
switch_4 = Custom[Switch](boolean_switch=Sheets, data=watch)
Links = Input()  # "Links?"
boolean = BoolSelector(true)
linksAndImports = Custom[Document.LinksAndImports](toggle=boolean)  # Gets all linked and imported files in the document. NOTE: Does *not* retrieve linked Revit files.
watch_2 = Watch(linksAndImports.links)
switch_5 = Custom[Switch](boolean_switch=Links, data=watch_2)
Imports = Input()  # "Imports?"
boolean_2 = BoolSelector(true)
linksAndImports_2 = Custom[Document.LinksAndImports](toggle=boolean_2)
watch_3 = Watch(linksAndImports_2.imports)
switch_6 = Custom[Switch](boolean_switch=Imports, data=watch_3)
Inplace_families = Input()  # "Inplace families?"
report_on_inplace_families = Custom[Report on Inplace Families]()
watch_4 = Watch(report_on_inplace_families.inplace_families)
switch_7 = Custom[Switch](boolean_switch=Inplace_families, data=watch_4)
Unused_families = Input()  # "Unused families?"
unused_families = Custom[Unused Families]()
watch_5 = Watch(unused_families)
switch_8 = Custom[Switch](boolean_switch=Unused_families, data=watch_5)
External_References = Input()  # "External References?"
get_external_file_references_and = Custom[Get External File References and Details]()  # including date modified
watch_6 = Watch(get_external_file_references_and.asElements)
switch_9 = Custom[Switch](boolean_switch=External_References, data=watch_6)
create = List.Create(switch, switch_2, switch_3, switch_4, switch_5, switch_6, switch_7, switch_8, switch_9)
flatten = Flatten(create)
Elements_collected = Output(flatten)
Delete = Input()  # "Delete?"
switch_10 = Custom[Switch](boolean_switch=Delete, data=flatten)
Tried_to_delete = Output(switch_10)
bv_erase_or_delete_from_model = Custom[bv Erase or Delete from Model](Element_s=switch_10)  # forked from SteamNodes
Failed_to_delete = Output(bv_erase_or_delete_from_model)
