# Dynamo custom node Select Elements Using BuiltIn Category Names.dyf (Dynamo 1.2.0.2690)
# category: Bakery.Revit.Selection
# works on a list of BuiltIn Names

builtIns = Input()
select_based_on_a_single_builtin = Custom[Select based on a single builtin name]()  # asdf; unwired: builtinName
map = List.Map(list=builtIns, f_x=select_based_on_a_single_builtin)
flatten = Flatten(map)
bv_remove_nulls = Custom[bv Remove Nulls](List=flatten)  # forked from Lunchbox
elements = Output(bv_remove_nulls)
