# Dynamo custom node Set Worksharing Display Mode for View.dyf (Dynamo 2.3.0.5885)
# category: Bakery.Revit.Views

View = Input(View: var[]..[])
WorksharingDisplayMode = Input(WorksharingDisplayMode: var[]..[])
python_script = Python(IN[0]=View, IN[1]=WorksharingDisplayMode)
# ---------- python_script.python (34 lines) ----------
import clr
clr.AddReference('RevitAPI')
from Autodesk.Revit.DB import *

clr.AddReference("RevitServices")
import RevitServices
from RevitServices.Persistence import DocumentManager
from RevitServices.Transactions import TransactionManager

doc = DocumentManager.Instance.CurrentDBDocument
viewinsts = UnwrapElement(IN[0])
wsmode = IN[1]
successlist = list()

booleans = list()
TransactionManager.Instance.EnsureInTransaction(doc)
for item in viewinsts:
	try:
#		p = item.get_Parameter(BuiltInParameter.VIEWER_OPTION_VISIBILITY)
#		p.Set(options[counter].Id)
		item.SetWorksharingDisplayMode(wsmode)
		booleans.append(True)
	except:
		booleans.append(False)
TransactionManager.Instance.TransactionTaskDone()

#for item in viewinsts:
#	try:
#		item.SetWorkSharingDisplayMode(wsmode)
#		successlist.append("Success")
#	except:
#		successlist.append("Failed")

OUT = booleans
# ----------------------------------------
out = Output(python_script)
