# Dynamo custom node Check Common Items between Two Lists and Get From One.dyf (Dynamo 0.8.2.2371)
# category: Bakery.Lists

in_this_and_get_from_this = Input()
searchForThese = Input(searchForThese : var[]..[])

# group: first cross-check
watch = Watch(in_this_and_get_from_this)
if_equal_return_index_using = Custom[If Equal Return Index using IndexOf](searchForThese=searchForThese, inThisList=watch)
getItemAtIndex = List.GetItemAtIndex(list=watch, index=if_equal_return_index_using)
removeNulls = Lists.Manage.RemoveNulls(getItemAtIndex)
watch_2 = Watch(removeNulls)

clean_output = Output(watch_2)
clean_list_of_indices_to_remove = Custom[Clean List of Indices to Remove Negative Values](indices=if_equal_return_index_using)
cleaned_indices = Output(clean_list_of_indices_to_remove)
