# Dynamo custom node Check Family Prefix for Model Elements.dyf (Dynamo 0.9.2.4472)
# category: Bakery.Revit.Elements.Family
# and returns statistics

list_of_model_elements = Custom[List of Model Elements simplified]()  # uses familyinstance select now
family = FamilyType.Family(list_of_model_elements.List_of_Types_symbols)
uniqueItems = List.UniqueItems(family)
watch = Watch(uniqueItems)
element_name_universal = Custom[Element Name Universal](Element_s=watch)  # Modified for 0.8.1
flatten = Flatten(element_name_universal)
flat_list_to_list_of_strings = Custom[Flat List to List of Strings](Original_List=flatten)  # using python methods
length = String.Length(flat_list_to_list_of_strings)
integer_slider = IntegerSlider(3, range=0..100 step 1)
sub = length - integer_slider
boolean = BoolSelector(false)
bv_slice_string = Custom[bv Slice String](String_s=flatten, of_Characters=sub, Left_Right=boolean)  # standalone
countOccurences = Custom[List.CountOccurences](seq=bv_slice_string)  # Counts the number of occurences of each unique element in a given list
maximumItem = List.MaximumItem(countOccurences.count)
create = List.Create(maximumItem)
bv_if_equal_return_index = Custom[bv If Equal Return Index](listA=create, listB=countOccurences.count)  # forked
getItemAtIndex = List.GetItemAtIndex(list=countOccurences.uniqueElements, index=bv_if_equal_return_index)
watch_2 = Watch(getItemAtIndex)
firstItem = List.FirstItem(watch_2)
Dominant_Prefix = Output(firstItem)
getItemAtIndex_2 = List.GetItemAtIndex(list=countOccurences.count, index=bv_if_equal_return_index)
watch_3 = Watch(getItemAtIndex_2)
firstItem_2 = List.FirstItem(watch_3)
How_many_use_Dominant_Prefix = Output(firstItem_2)  # "How many use Dominant Prefix?"
turnIntoList = Custom[Turn Into List](unknownItem=firstItem)  # Turns an element into a (flat) list
bv_if_equal_return_index_2 = Custom[bv If Equal Return Index](listA=turnIntoList, listB=countOccurences.uniqueElements)

# group: count others
removeItemAtIndex = List.RemoveItemAtIndex(list=countOccurences.count, indices=bv_if_equal_return_index_2)
sum = Math.Sum(removeItemAtIndex)
round = Math.Round(sum)
watch_4 = Watch(removeItemAtIndex)

turnIntoList_2 = Custom[Turn Into List](unknownItem=round)
list_of_float_double_to_list_of = Custom[List of float double to list of Int](double=turnIntoList_2)  # no decimals
firstItem_3 = List.FirstItem(list_of_float_double_to_list_of)

# group (continued): count others
Non_compliant_families = Output(firstItem_3)

# group: data
create_2 = List.Create(countOccurences.uniqueElements, countOccurences.count)
Prefixes_in_Use = Output(create_2)

bv_get_category_name = Custom[bv Get Category Name](Elements=list_of_model_elements.Element_List)  # forked from Blackbox
uniqueItems_2 = List.UniqueItems(bv_get_category_name)

# group: categories
watch_5 = Watch(uniqueItems_2)
sort = List.Sort(watch_5)
Categories_checked = Output(sort)

Family_Names_gathered = Output(flat_list_to_list_of_strings)
watch_6 = Watch(countOccurences.uniqueElements)
watch_7 = Watch(bv_slice_string)
eq = firstItem == watch_7
filterByBoolMask = List.FilterByBoolMask(list=flat_list_to_list_of_strings, mask=eq)
example_non_compliant = Output(filterByBoolMask.out)
