# Dynamo custom node Clean Link Name List.dyf (Dynamo 0.8.2.2371)
# category: Bakery.Links

name_list = Input()
code_block = CodeBlock { "replacedNull"; }
replaceNulls = Lists.Manage.ReplaceNulls(name_list, code_block)
flat_list_to_list_of_strings = Custom[Flat List to List of Strings](Original_List=replaceNulls)  # using python methods
code_block_2 = CodeBlock { " : "; }
split = String.Split(flat_list_to_list_of_strings, code_block_2)
firstItem = List.FirstItem()
map = List.Map(list=split, f_x=firstItem)
cleaned_names_only = Output(map)
