# Dynamo custom node Compare Two IFCs by GUIDs.dyf (Dynamo 1.1.0.2094)
# category: Bakery.IFC

olderIFCfile = Input()
get_unique_guids_from_ifc_file = Custom[Get Unique GUIDs from IFC File](path=olderIFCfile)  # input is File Path to IFC
watch = Watch(get_unique_guids_from_ifc_file)
newerIFCfile = Input()
get_unique_guids_from_ifc_file_2 = Custom[Get Unique GUIDs from IFC File](path=newerIFCfile)
watch_2 = Watch(get_unique_guids_from_ifc_file_2)
compare_two_lists_by_item_and = Custom[Compare Two Lists by Item and Return Item Differences](listONE=watch, listTWO=watch_2)

# group: new items
watch_3 = Watch(compare_two_lists_by_item_and.inListTWObutNotInListOne)

addedToNewFile = Output(watch_3)

# group: items removed from new file
watch_4 = Watch(compare_two_lists_by_item_and.inListONEbutNotInListTwo)

removedFromNewFile = Output(watch_4)
