# Dynamo custom node Convert Builtin Category Name to Normal Name.dyf (Dynamo 1.1.0.2065)
# category: Bakery.Categories

get_categories_with_builtins = Custom[Get Categories with Builtins]()  # Lists: Category Names, internal api definition, Built In Category Names, Ids
builtInNameStrings = Input()
create = List.Create(builtInNameStrings)
bv_if_equal_return_index = Custom[bv If Equal Return Index](listA=create, listB=get_categories_with_builtins.Builtin_Name_Strings)  # forked
getItemAtIndex = List.GetItemAtIndex(list=get_categories_with_builtins.Names, index=bv_if_equal_return_index)
categoryName = Output(getItemAtIndex)
