# Dynamo custom node Copy Workset Name to Target Parameter.dyf (Dynamo 0.8.0.950)
# category: Bakery.Parameters
# uses archi-lab

string = StringInput("Workset")
targetParameter = Input()
elementList = Input()
watch = Watch(elementList)
copy_property_to_parameter_for = Custom[Copy Property to Parameter for List of Elements](sourcePropertyAsString=string, targetParameterAsString=targetParameter, listOfElements=watch)  # Uses bruteforce get parameter which works for Worksets etc
feedback = Output(copy_property_to_parameter_for)
