# Dynamo custom node Create Worksets for Revit Link Filenames.dyf (Dynamo 0.8.2.2371)
# category: Bakery.Worksets

worksets = Custom[Document.Worksets]()  # Returns all Worksets in the current document
element_name_universal = Custom[Element Name Universal](Element_s=worksets)  # Modified for 0.8.1
get_linked_rvt_documents = Custom[Get Linked RVT Documents]()
clean_link_name_list = Custom[Clean Link Name List](name_list=get_linked_rvt_documents.Link_Name)
remove_list_from_list_by_item = Custom[Remove List from List by Item not Value](ListOfItemsToRemove=element_name_universal, ListToRemoveFrom=clean_link_name_list)  # remove the items in ListA from the items in ListB and return whats left
string = StringInput("")
PrefixIfDesired = Input(PrefixIfDesired : string = "")
join = String.Join(string, PrefixIfDesired)
map = List.Map(list=remove_list_from_list_by_item.reducedList, f_x=join)
create = Custom[Workset.Create](worksetNames=map)  # Creates a workset or worksets from input names.
worksetsCreated = Output(create)
