# Dynamo custom node Duplicate View and Isolate Elements.dyf (Dynamo 0.9.2.4472)
# category: Bakery.Revit.Elements

elementsIn = Input()
watch = Watch(elementsIn)
bv_elements_to_ids = Custom[bv Elements to IDs](Element_s=watch)  # forked from CAAD_RWTH
bv_ids_to_elements = Custom[bv IDs to Elements](ID_s=bv_elements_to_ids.ID_s)  # forked from CAAD_RWTH
red = Custom[Color.Red]()  # Returns the colour red.
overrideColorInView = Element.OverrideColorInView(element=bv_ids_to_elements.Element_s, color=red)
sourceViewIn = Input()
duplicate = Custom[View.Duplicate](View_s=sourceViewIn)  # Duplicates a given view
isolate_in_view = Custom[Isolate in View](Element=overrideColorInView, View=duplicate)  # This node will take input of elements and a view to isolate selected elements in a view.
done = Output(isolate_in_view)
watch_2 = Watch(bv_ids_to_elements.Element_s)
ViewOut = Output(duplicate)
