# Dynamo custom node Element Type Reporting.dyf (Dynamo 0.9.2.4472)
# category: Bakery.Revit.Document.Utility
# searches element types for strings and gives data

string = StringInput("Family and Type")
Element_Types = Input()
Search_for_Case_ignored = Input()  # "Search for (Case ignored)"
getElementsContaining = Custom[GetElementsContaining](Element_Types=Element_Types, Search_for_Case_ignored=Search_for_Case_ignored)  # This node search the selected element type for a inputvalue(string) and returns a list of the elements containing the given input.
parameters = Element.Parameters(getElementsContaining)
string_from_object = FromObject(parameters)
search_element_parameters_for = Input()
contains = String.Contains(str=string_from_object, searchFor=search_element_parameters_for)
anyTrue = Custom[List.AnyTrue](seq=contains)  # Returns true if any item in a list of booleans is true.
Any_of_these = Output(anyTrue)  # "Any of these?"
getParameterValueByName = Element.GetParameterValueByName(element=getElementsContaining)
boolean = BoolSelector(true)
create = List.Create(boolean)
boolean_2 = BoolSelector(true)
sublistsContain = Custom[List.SublistsContain](seq=contains, item=boolean_2)  # Looks for an item in each sublist of a given list and returns true/false for each sublist.
bv_if_equal_return_index = Custom[bv If Equal Return Index](listA=create, listB=sublistsContain)  # forked
getItemAtIndex = List.GetItemAtIndex(list=getParameterValueByName, index=bv_if_equal_return_index)
Elements = Output(getItemAtIndex)
watch = Watch(parameters)
