# Dynamo custom node Find Empty Parameter and Populate with Other.dyf (Dynamo 0.9.2.4472)
# category: Bakery.Revit.Parameters
# also has some other string operations

copyFrom = Input()
Category = Input()
all_elements_of_category = ElementsOfCategory(Category)
parameterToCheck = Input()
parameterExists = Custom[Element.ParameterExists](param=parameterToCheck, element=all_elements_of_category)  # Checks if an element contains a parameter of a given name
filterByBoolMask = List.FilterByBoolMask(list=all_elements_of_category, mask=parameterExists)
Already_With_Values = Output(filterByBoolMask.out)
string = StringInput("")
length = String.Length(string)
create = List.Create(length)
getParameterValueByName = Element.GetParameterValueByName(element=filterByBoolMask.in)
flat_list_to_list_of_strings = Custom[Flat List to List of Strings](Original_List=getParameterValueByName)  # using python methods
length_2 = String.Length(flat_list_to_list_of_strings)
bv_if_equal_return_index = Custom[bv If Equal Return Index](listA=create, listB=length_2)  # forked
getItemAtIndex = List.GetItemAtIndex(list=filterByBoolMask.in, index=bv_if_equal_return_index)
setParameterByName = Element.SetParameterByName(element=getItemAtIndex, parameterName=parameterToCheck)
Parameter_Copied = Output(setParameterByName)
getParameterValueByName_2 = Element.GetParameterValueByName(element=getItemAtIndex)
flat_list_to_list_of_strings_2 = Custom[Flat List to List of Strings](Original_List=getParameterValueByName_2)
replaceThis = Input()
withThis = Input()
replace = String.Replace(str=flat_list_to_list_of_strings_2, searchFor=replaceThis, replaceWith=withThis)
length_3 = String.Length(replace)
deleteThisManyCharsFromEnd = Input()
sub = length_3 - deleteThisManyCharsFromEnd
remove = String.Remove(str=replace, startIndex=sub, count=deleteThisManyCharsFromEnd)
checkLastCharacterIsThis = Input()
endsWith = String.EndsWith(remove, checkLastCharacterIsThis)
Does_it_end_with_nominated_character = Output(endsWith)  # "Does it end with nominated character?"
