# Dynamo custom node Get Actual Elements from Linked Tag Ids.dyf (Dynamo 0.8.2.2371)
# category: Bakery.Links

taglist = Input()
code_block = CodeBlock { 2; }
getItemAtIndex = List.GetItemAtIndex(index=code_block)
map = List.Map(list=taglist, f_x=getItemAtIndex)
get_link_document_from_link = Custom[Get Link Document from Link Instance Id]()
map_2 = List.Map(list=map, f_x=get_link_document_from_link)
firstItem = List.FirstItem(map_2)
code_block_2 = CodeBlock { 1; }
getItemAtIndex_2 = List.GetItemAtIndex(index=code_block_2)
map_3 = List.Map(list=taglist, f_x=getItemAtIndex_2)
firstItem_2 = List.FirstItem(map_3)
isNull = Object.IsNull(map_2)
filterByBoolMask = List.FilterByBoolMask(list=map_3, mask=isNull)
watch = Watch(filterByBoolMask.out)
firstItem_3 = List.FirstItem(watch)
filterByBoolMask_2 = List.FilterByBoolMask(list=map_2, mask=isNull)
watch_2 = Watch(filterByBoolMask_2.out)
firstItem_4 = List.FirstItem(watch_2)
filterByBoolMask_3 = List.FilterByBoolMask(list=taglist, mask=isNull)
not_a_Linked_Tag = Output(filterByBoolMask_3.in)
Link_Tags_Used = Output(filterByBoolMask_3.out)
count = Count(watch_2)
code_block_3 = CodeBlock(x=count) { 0..(x-1); }
get_list_of_linked_elements_from = Custom[Get List of Linked Elements from Id and Doc](list=watch_2, list_2=watch)
map_4 = List.Map(list=code_block_3, f_x=get_list_of_linked_elements_from)
Link_Elements = Output(map_4)
Link_Docs = Output(watch_2)
code_block_4 = CodeBlock { 3; }
getItemAtIndex_3 = List.GetItemAtIndex(index=code_block_4)
map_5 = List.Map(list=taglist, f_x=getItemAtIndex_3)
filterByBoolMask_4 = List.FilterByBoolMask(list=map_5, mask=isNull)
Link_Tag_Elements_Used = Output(filterByBoolMask_4.out)
