# Dynamo custom node Get All Revit Links as Element List.dyf (Dynamo 0.9.1.4062)
# category: Bakery.Links

current_document = Custom[Current Document]()  # Retrieves Current Document
get_linked_rvt_documents = Custom[Get Linked RVT Documents]()
element_ids = Custom[Element Ids](Element_s=get_linked_rvt_documents.Link_Instance)  # This node will query an element id that can be used with Revit nodes. Dynamo Element Id node returns integer value.
id_to_element = Custom[Id to Element](Id=element_ids.Rvt_ElementId_s)  # Selects elements in a model from id input (ElementId, string, integer or GUID)
RevitLinkElements = Output(id_to_element)
