# Dynamo custom node Get Elements By Workset Id.dyf (Dynamo 1.2.0.2690)
# category: Bakery.Revit.Document.Worksets

WORKSETID = Input()
python_script = Python(IN[0]=WORKSETID)
# ---------- python_script.python (27 lines) ----------
#LSJ

import clr
clr.AddReference('ProtoGeometry')
from Autodesk.DesignScript.Geometry import *

# Import DocumentManager
clr.AddReference("RevitServices")
import RevitServices
from RevitServices.Persistence import DocumentManager

# Import RevitAPI
clr.AddReference("RevitAPI")
import Autodesk

# Import ToDSType(bool) extension method
clr.AddReference("RevitNodes")
import Revit
from Autodesk.Revit.DB import *
clr.ImportExtensions(Revit.Elements)

import System

worksetId = IN
worksetFilter = ElementWorksetFilter(worksetId)
collector = FilteredElementCollector(doc).WherePasses(worksetFilter).ToElements()
OUT = collector
# ----------------------------------------
elements = Output(python_script)
