# Dynamo custom node Get Link Document from Link Instance Id.dyf (Dynamo 0.8.2.2392)
# category: Bakery.Links

get_linked_rvt_documents = Custom[Get Linked RVT Documents]()
index0 = Input()
create = List.Create(index0)
bv_if_equal_return_index = Custom[bv If Equal Return Index](listA=create, listB=get_linked_rvt_documents.Link_Instance_Id)  # forked
getItemAtIndex = List.GetItemAtIndex(list=get_linked_rvt_documents.Link_Doc, index=bv_if_equal_return_index)
watch = Watch(getItemAtIndex)
firstItem = List.FirstItem(watch)
doc = Output(firstItem)
