# Dynamo custom node Get Linked Element from Element Id and Doc.dyf (Dynamo 0.8.2.2371)
# category: Bakery.Links

Link_Name_string = Input()
watch = Watch(Link_Name_string)
get_link_document_from_link_name = Custom[Get Link Document from Link Name](searchFor=watch)
Document = Output(get_link_document_from_link_name)
Element_Ids = Input()
get_element_from_doc_using = Custom[Get Element from Doc using Element Id](linkdoc=get_link_document_from_link_name, elementId=Element_Ids)
Element = Output(get_element_from_doc_using.Matching)
location = FamilyInstance.Location(get_element_from_doc_using.Matching)
Point = Output(location)

# group: STARTED GETTING SYSTEM FAMILIES
string = StringInput("Air Terminals")
create = List.Create(string)
convert_category_name_to_built = Custom[Convert Category Name to Built In Category Name](categoryName=create)  # You must use List.Map to convert list of Category Names to list of Built In Names
get_elements_from_link_document = Custom[Get Elements from Link Document Using Category](Link_Document=get_link_document_from_link_name)
map = List.Map(list=convert_category_name_to_built, f_x=get_elements_from_link_document)
flatten = Flatten(map)
create_2 = List.Create(get_element_from_doc_using.AllElements, flatten)
flatten_2 = Flatten(create_2)
