# Dynamo custom node Get Percentage as String given Value and Total.dyf (Dynamo 1.0.0.1180)
# category: Bakery.Core.Math

partialList = Input()
totalList = Input()
code_block = CodeBlock(x=partialList, y=totalList) { x/y*100; }
list_of_float_double_to_list_of = Custom[List of float double to list of Int](double=code_block)  # no decimals
flat_list_to_list_of_strings = Custom[Flat List to List of Strings](Original_List=list_of_float_double_to_list_of)  # using python methods
code_block_2 = CodeBlock { " %"; }
concat = String.Concat(arg1=code_block_2)
map = List.Map(list=flat_list_to_list_of_strings, f_x=concat)
percentage_as_string = Output(map)
