# Dynamo custom node Get Tagged Linked Element Id.dyf (Dynamo 0.8.2.2371)
# category: Bakery.Elements

Tags = Input()
turn_into_list = Custom[Turn Into List](item=Tags)  # Turns an element into a (flat) list
get_info_from_a_linked_element = Custom[Get Info from a Linked Element Tag]()
map = List.Map(list=turn_into_list, f_x=get_info_from_a_linked_element)
ElementInfos = Output(map)
