# Dynamo custom node Get Unique GUIDs from IFC File.dyf (Dynamo 1.1.0.2094)
# category: Bakery.IFC
# input is File Path to IFC

string = StringInput(",'ID(.*?)'")
path = Input()
fromPath = FileObject(path)  # "File.FromPath"
readText = File.ReadText(fromPath)
findRegularExpression = Custom[String.FindRegularExpression](RegEx=string, str=readText)  # Returns all occurences of a regular expression within a string (or list of strings). The syntax for regular expressions is explained at http://ironpython-test.readthedocs.org/en/latest/howto/regex.html
uniqueItems = List.UniqueItems(findRegularExpression)
list = Output(uniqueItems)
