# Dynamo custom node Get View Parameter and Parse for Locate32 Search.dyf (Dynamo 0.9.2.4472)
# category: Bakery.Revit.Parameters

viewFromViewsList = Input()
id = Element.Id(viewFromViewsList)
bv_ids_to_elements = Custom[bv IDs to Elements](ID_s=id)  # forked from CAAD_RWTH
firstItem = List.FirstItem(bv_ids_to_elements.Element_s)
parameterName = Input()
getParameterValueByName = Element.GetParameterValueByName(element=firstItem, parameterName=parameterName)
string = StringInput("\n")
code_block = CodeBlock { " \ "; }
replace = String.Replace(str=getParameterValueByName, searchFor=string, replaceWith=code_block)
stringForLocate32Search = Output(replace)
watch = Watch(firstItem)
