# Dynamo custom node Line Break String with Ids to Revit Elements.dyf (Dynamo 0.9.1.4062)
# category: Bakery.Collect

stringWithLineBreaks = Input()
convert_string_with_line_breaks = Custom[Convert String with Line Breaks into List of Strings](string=stringWithLineBreaks)
toNumber = String.ToNumber(convert_string_with_line_breaks)
id_to_element = Custom[Id to Element](Id=toNumber)  # Selects elements in a model from id input (ElementId, string, integer or GUID)
Elements = Output(id_to_element)
