# Dynamo custom node List Groups.dyf (Dynamo 0.8.2.2371)
# category: Bakery.Elements

list_groups = Python()
# ---------- list_groups.python (46 lines) ----------
#Copyright(c) 2014, Nathan Miller
# The Proving Ground, http://theprovingground.org

import clr

# Import RevitAPI
clr.AddReference("RevitAPI")
import Autodesk
from Autodesk.Revit.DB import *

# Import DocumentManager and TransactionManager
clr.AddReference("RevitServices")
import RevitServices
from RevitServices.Persistence import DocumentManager
from RevitServices.Transactions import TransactionManager

# Import ToDSType(bool) extension method
clr.AddReference("RevitNodes")
import Revit
clr.ImportExtensions(Revit.Elements)

#The input to this node will be stored in the IN[0] variable.

doc =  DocumentManager.Instance.CurrentDBDocument
app =  DocumentManager.Instance.CurrentUIApplication.Application


collector = FilteredElementCollector(doc)
#collector.OfCategory(Group)
collector.OfClass(Group)
 
famtypeitr = collector.GetElementIdIterator()
famtypeitr.Reset()

outlist = []
groups = []
locations = []

for item in famtypeitr:
	groups.append((item))


    
   
#Assign your output to the OUT variable
OUT = groups
# ----------------------------------------
Groups = Output(list_groups)
