# Dynamo custom node Offset Point Z Value.dyf (Dynamo 1.2.0.2831)
# category: Bakery.Geometry

points = Input()
removeNulls = Lists.Manage.RemoveNulls(points)
watch = Watch(removeNulls)
X = Point.X(watch)
Y = Point.Y(watch)
Z = Point.Z(watch)
desiredOffset = Input()
code_block = CodeBlock(z=Z, y=desiredOffset) { z+y; }
byCoordinates = Point.ByCoordinates(x=X, y=Y, z=code_block)
Point = Output(byCoordinates)
