# Dynamo custom node Read Excel Into Lists.dyf (Dynamo 1.2.1.3083)
# category: Bakery.Office.Excel

string = StringInput("NULL_VALUE")
path = Input()
fromPath = FileObject(path)  # "File.FromPath"
sheetName = Input(sheetName : string)
readFromFile = Excel.ReadFromFile(file=fromPath, sheetName=sheetName)
bv_replace_nulls = Custom[bv Replace Nulls](replacement=string, seq=readFromFile)
dropRows = Input()
dropItems = List.DropItems(list=bv_replace_nulls, amount=dropRows)
watch = Watch(dropItems)
firstItem = List.FirstItem(watch)
headings = Output(firstItem)
code_block = CodeBlock { 1; }
dropItems_2 = List.DropItems(list=watch, amount=code_block)
data = Output(dropItems_2)
