# Dynamo custom node Reduce Text File Data.dyf (Dynamo 1.2.1.3083)
# category: Bakery.Standalone

path = Input()
text_file_to_list_of_strings = Custom[Text File to List of Strings](path=path)
shuffle = List.Shuffle(text_file_to_list_of_strings)
takeEveryNthItem = Input()
takeEveryNthItem_2 = List.TakeEveryNthItem(shuffle, takeEveryNthItem)
reducedList = Output(takeEveryNthItem_2)
count = Count(shuffle)
originalDataLength = Output(count)
count_2 = Count(takeEveryNthItem_2)
reducedDataLength = Output(count_2)
