# Dynamo custom node Rename Families with a Prefix.dyf (Dynamo 0.9.2.4472)
# category: Bakery.Revit.Elements.Family

familyList = Input()
flatten = Flatten(familyList)
uniqueItems = List.UniqueItems(flatten)
element_name_universal = Custom[Element Name Universal](Element_s=uniqueItems)  # Modified for 0.8.1
code_block = CodeBlock { ""; }
desired_Prefix = Input()
join = String.Join(code_block, desired_Prefix)
map = List.Map(list=element_name_universal, f_x=join)
flatten_2 = Flatten(map)
setName = Custom[Element.SetName](element=uniqueItems, name=flatten_2)  # Gets the name of a given Revit element
rename_Success = Output(setName.Success)
rename_Fail = Output(setName.Fail)
new_Names = Output(flatten_2)
count = Count(uniqueItems)
Number_of_families = Output(count)
