# Dynamo custom node Sample Curve By Divisions.dyf (Dynamo 1.3.0.875)
# category: Bakery.Geometry

points = Input(points : Point[])
byControlPoints = NurbsCurve.ByControlPoints(points)
nurbsCurve = Output(byControlPoints)
divisions = Input()
code_block = CodeBlock(z=divisions) { 0..1..(1/z); }
pointAtParameter = Curve.PointAtParameter(curve=byControlPoints, param=code_block, lacing=Longest)
create = List.Create(pointAtParameter)
watch = Watch(create)
sampled = Output(watch)
