# Dynamo custom node Search One List Based on Second List and Get Values.dyf (Dynamo 0.8.2.2392)
# category: Bakery.Lists
# get values from a 3rd list or the 1st list

listOfValuesToFind = Input()
listToSearchForValues = Input()
firstIndexOf = List.FirstIndexOf(list=listToSearchForValues)
map = List.Map(list=listOfValuesToFind, f_x=firstIndexOf)
listToGetValuesFrom = Input()
count = Count(listToGetValuesFrom)
code_block = CodeBlock { -1; }
eq = _ == code_block
replaceByCondition = Replace(map, count, eq)
indices = Output(replaceByCondition)
ReplaceNullsWith = Input()
addItemToEnd = List.AddItemToEnd(ReplaceNullsWith, listToGetValuesFrom)
watch = Watch(addItemToEnd)
replaceNulls = Lists.Manage.ReplaceNulls(watch, ReplaceNullsWith)

# group: fix the -1 input to this
getItemAtIndex = List.GetItemAtIndex(list=replaceNulls, index=replaceByCondition)

watch_2 = Watch(getItemAtIndex)
values = Output(watch_2)
