# Dynamo custom node Search by Workset and return Items.dyf (Dynamo 0.9.2.4472)
# category: Bakery.Revit.Selection
# also has a bool result, FALSE if it contains items, TRUE if empty

get_worksets = Custom[Get Worksets]()  # Retrieves user worksets from specified document
Workset_Name = Input()
string_from_object = FromObject(Workset_Name)
turnIntoList = Custom[Turn Into List](unknownItem=string_from_object)  # Turns an element (or a nested list) into a flat list
turnIntoList_2 = Custom[Turn Into List](unknownItem=get_worksets.Names)
bv_if_equal_return_index = Custom[bv If Equal Return Index](listA=turnIntoList, listB=turnIntoList_2)  # forked
getItemAtIndex = List.GetItemAtIndex(list=get_worksets.Ids, index=bv_if_equal_return_index)
string_from_object_2 = FromObject(getItemAtIndex)
toNumber = String.ToNumber(string_from_object_2)
collect_all_elements_in_model = Custom[Collect All Elements in Model faster]()  # does not report count or categories
flatten = Flatten(collect_all_elements_in_model.elementList)
getParameterValueByName = Element.GetParameterValueByName(element=flatten)
bv_if_equal_return_index_2 = Custom[bv If Equal Return Index](listA=toNumber, listB=getParameterValueByName)
isEmpty = List.IsEmpty(bv_if_equal_return_index_2)
watch = Watch(isEmpty)
True_if_Empty = Output(watch)
getItemAtIndex_2 = List.GetItemAtIndex(list=flatten, index=bv_if_equal_return_index_2)
ID = Custom[Elements to IDs](element=getItemAtIndex_2)  # "Element.ID"; Gets the ID(s) for a list of Revit elements (or a single element)
watch_2 = Watch(ID.ID)
Elements_on_Workset = Output(watch_2)
