# Dynamo custom node Set Parameter of View based on a Character in Sheet Number.dyf (Dynamo 0.8.2.2392)
# category: Bakery.Views

ViewsIn = Input()
code_block = CodeBlock { "Sheet Number"; }
getParameterValueByName = Element.GetParameterValueByName(element=ViewsIn, parameterName=code_block)
code_block_2 = CodeBlock { "---"; }
eq = getParameterValueByName == code_block_2
filterByBoolMask = List.FilterByBoolMask(list=ViewsIn, mask=eq)
watch = Watch(filterByBoolMask.out)
ParameterToSet = Input()
turn_into_list = Custom[Turn Into List](item=ParameterToSet)  # Turns an element into a list
count = Count(watch)
cycle = List.Cycle(list=turn_into_list, amount=count)
code_block_3 = CodeBlock { "Sheet Number"; }
getParameterValueByName_2 = Element.GetParameterValueByName(element=filterByBoolMask.out, parameterName=code_block_3)
CharacterIndex = Input()
bv_get_character_from_string_at = Custom[bv Get Character from String at Index](List=getParameterValueByName_2, Index=CharacterIndex)  # forked from Rhythm
setParameterByName = Element.SetParameterByName(element=watch, parameterName=cycle, value=bv_get_character_from_string_at)
Done = Output(setParameterByName)
watch_2 = Watch(getParameterValueByName_2)
