# Dynamo custom node Sheet Reporting and Validation.dyf (Dynamo 0.9.2.4472)
# category: Bakery.Revit.Views.Sheet
# tests schedules not on sheets, lists sheets

current_document = Custom[Current Document]()  # Retrieves Current Document
string = StringInput("Sheet Number")
string_2 = StringInput("Sheet Name")
categories = Categories("Sheets")
all_elements_of_category = ElementsOfCategory(categories)
watch = Watch(all_elements_of_category)
firstItem = List.FirstItem(watch)
parameters = Element.Parameters(firstItem)
sample_parameter_set = Output(parameters)
string_3 = StringInput("--No Sheets in Model?--")
integer_slider = IntegerSlider(1, range=0..100 step 1)
count = List.Count(watch)
lt = integer_slider < count
string_4 = StringInput("--Schedules not on Sheets?--")
schedules_on_sheets = Custom[Schedules on Sheets]()  # Queries all schedules and produces two lists: one with all schedules that are placed on sheets and one with schedules that are not placed on sheets.
string_5 = StringInput("--Sheet List below--")
bv_elements_to_ids = Custom[bv Elements to IDs](Element_s=watch)  # forked from CAAD_RWTH
bv_ids_to_elements = Custom[bv IDs to Elements](ID_s=bv_elements_to_ids.ID_s)  # forked from CAAD_RWTH
getParameterValueByName = Element.GetParameterValueByName(element=bv_ids_to_elements)
getParameterValueByName_2 = Element.GetParameterValueByName(element=bv_ids_to_elements)
create = List.Create(getParameterValueByName, getParameterValueByName_2)
create_2 = List.Create(string_3, lt, string_4, schedules_on_sheets.Not_on_Sheets, string_5, create)
List_with_inline_headings = Output(create_2)
Document_has_sheets = Output(lt)  # "Document has sheets?"
