# Dynamo custom node Show Categories containing Family Instances.dyf (Dynamo 0.9.1.4062)
# category: Bakery.Categories
# list

collect_all_familyinstance_using = Custom[Collect all FamilyInstance using Element Types]()  # should get model family instances
categoryName = Custom[Get.CategoryName](Elements=collect_all_familyinstance_using)  # Get the category of an element
uniqueItems = List.UniqueItems(categoryName)
sort = List.Sort(uniqueItems)
Categories = Output(sort)
