# Dynamo custom node Show Dependency Nodes for one DYF.dyf (Dynamo 0.9.1.4062)
# category: Bakery.Standalone
# used with List.Map for a folder of them

code_block = CodeBlock { "nickname="; }
path_to_DYF = Input()
fromPath = FileObject(path_to_DYF)  # "File.FromPath"
readText = File.ReadText(fromPath)
string = StringInput("nickname=\"")
split = String.Split(readText, string)
watch = Watch(split)
code_block_2 = CodeBlock { 1; }
dropItems = List.DropItems(list=watch, amount=code_block_2)
string_2 = StringInput("\" ")
split_2 = String.Split(arg1=string_2)
map = List.Map(list=dropItems, f_x=split_2)
watch_2 = Watch(map)
code_block_3 = CodeBlock { 0; }
getItemAtIndex = List.GetItemAtIndex(index=code_block_3)
map_2 = List.Map(list=watch_2, f_x=getItemAtIndex)
uniqueItems = List.UniqueItems(map_2)
names = Output(uniqueItems)
code_block_4 = CodeBlock { 0; }
code_block_5 = CodeBlock { 1; }
code_block_6 = CodeBlock { 1; }
code_block_7 = CodeBlock { x-1; }
