# Dynamo custom node Two Point Lists to Joined Curve.dyf (Dynamo 1.2.0.2690)
# category: Bakery.BETA

endPoint = Input(endPoint : Point)
byPoints = PolyCurve.ByPoints(points=endPoint)
startPoint = Input(startPoint : Point)
byPoints_2 = PolyCurve.ByPoints(points=startPoint)
byStartPointEndPoint = Line.ByStartPointEndPoint(startPoint=startPoint, endPoint=endPoint, lacing=Longest)
firstItem = List.FirstItem(byStartPointEndPoint@L2)
lastItem = List.LastItem(byStartPointEndPoint@L2)
create = List.Create(byPoints, byPoints_2, firstItem, lastItem)
flatten = Flatten(create)
group_curves = Custom[Group Curves](Curves=flatten)  # This node will take any input of flat list of curves and group them into sublists containing "joinable" curves that is continous curves. They might form closed curves or open curves. Use PolyCurve.ByJoinedCurves to convert output groups of curves into single PolyCurves
firstItem_2 = List.FirstItem(group_curves)
uniqueItems = List.UniqueItems(firstItem_2)
byJoinedCurves = PolyCurve.ByJoinedCurves(uniqueItems)
PolyCurve = Output(byJoinedCurves)
