# Dynamo custom node bv Get Category Name.dyf (Dynamo 0.8.2.2392)
# category: Bakery.Dynamo.ForkedNodes
# forked from Blackbox

empty = List.Empty()
Elements = Input()
create = List.Create(empty, Elements)
flatten = Flatten(create)
py_getcategorynameofelement = Python(IN[0]=flatten)
# ---------- py_getcategorynameofelement.python (41 lines) ----------
#Copyright(c) 2014, Jason Andersen, andersen.ja@gmail.com
import clr

# Import RevitAPI
clr.AddReference("RevitAPI")
import Autodesk
from Autodesk.Revit.DB import *

# Import DocumentManager and TransactionManager
clr.AddReference("RevitServices")
import RevitServices
from RevitServices.Persistence import DocumentManager
from RevitServices.Transactions import TransactionManager

# Import ToDSType(bool) extension method
clr.AddReference("RevitNodes")
import Revit
clr.ImportExtensions(Revit.Elements)
clr.ImportExtensions(Revit.GeometryConversion)

import clr
clr.AddReference('ProtoGeometry')
from Autodesk.DesignScript.Geometry import *

doc =  DocumentManager.Instance.CurrentDBDocument
app =  DocumentManager.Instance.CurrentUIApplication.Application


#The input to this node will be stored in the IN[0] variable.
elements = UnwrapElement(IN[0])

#variables
output = []
catName = []

for item in elements:
    #print faminst
	catName.append(item.Category.Name)  	    	
output.append(catName)

OUT = output
# ----------------------------------------
flatten_2 = Flatten(py_getcategorynameofelement)
Category_Name = Output(flatten_2)
