# Dynamo custom node bv Get Character from String at Index.dyf (Dynamo 0.9.2.4472)
# category: Bakery.Dynamo.ForkedNodes
# forked from Rhythm

List = Input()
Index = Input()
code_block = CodeBlock(List, Index)
# ---------- code_block.designscript (5 lines) ----------
def CharacterAtIndex (x,y)
{
return=x[y];
};
CharacterAtIndex(x,y);
# ----------------------------------------
Character = Output(code_block)
