# Dynamo custom node bv IDs to Elements.dyf (Dynamo 1.3.0.875)
# category: Bakery.Dynamo.ForkedNodes
# forked from CAAD_RWTH

IDs = Input()
byID = Custom[Element.ByID](ID_UniqueId=IDs)  # Gets the Revit element(s) for a list of IDs (or a single ID)
Element_s = Output(byID.element)  # "Element(s)"
