# Dynamo custom node bv Replace Nulls.dyf (Dynamo 0.9.2.4472)
# category: Bakery.Dynamo.ForkedNodes
# Python version

seq = Input()
replacement = Input()
replaceNulls = Lists.Manage.ReplaceNulls(seq, replacement)
seq_2 = Output(replaceNulls)  # "seq"
