# Dynamo custom node mysql Send List to Db for Multiple Columns.dyf (Dynamo 0.8.2.2371)
# category: LSJ

dataLists = Input()
transpose = List.Transpose(dataLists)
string_from_object = FromObject()
map = List.Map(list=transpose, f_x=string_from_object)
ColumnNameList = Input()
dbName = Input()
tableName = Input()
mysql_insert_data_into_new_rows = Custom[mysql Insert Data into New Rows for Multiple Columns](ColumnNameList=ColumnNameList, dbName=dbName, tableName=tableName)
map_2 = List.Map(list=map, f_x=mysql_insert_data_into_new_rows)
watch = Watch(map_2)
Success = Output(watch)  # "Success?"
